# Grasshopper definition Vector-BasedShadow_Study.gh (Grasshopper 1.0.7)

# This component still needs so much work to be fully functional. Here is just a simple example.
ladybug = Ladybug_Ladybug()  # -> Vviiiiiiiiiizzz; plug-in component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
ground = Brep(<brep referenced from the Rhino model>)
brep = Brep(<brep referenced from the Rhino model>)
open_weather_file = Ladybug_OpenEPWWeatherFile(open=Toggle(True))  # -> epwFile; plug-in component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
importepw = Ladybug_ImportEpw(epwFile=open_weather_file)  # -> readMe, latitude, location, dryBulbTemperature, dewPointTemperature, relativeHumidity, windSpeed, windDirection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; plug-in component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
wires = BrepWireframe(Brep=[ground, brep], Density=-1)
sunpath = Ladybug_SunPath(
    location=importepw.location,
    hour=Slider(14, range=0..100),
    day=Slider(14, range=0..100),
    month=Slider(2, range=0..100),
    timeStep=1,
    sunPathScale=Slider(0.5, range=0..1),
    dailyOrAnnualSunPath=True)  # -> readMe, sunVectors, sunAltitudes, sunAzimuths, port, sunSpheresMesh, sunPathCrvs, compassCrvs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; plug-in component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
shadowrange = Ladybug_ShadowStudy(geometry=[ground, brep], sunVector=sunpath.sunVectors)  # -> readMe, shadow, shade; plug-in component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
boundary = BoundarySurfaces(Edges=shadowrange.shade)
boundary_2 = BoundarySurfaces(Edges=shadowrange.shadow)
mesh = Mesh(shadowrange.shadow)
mesh_2 = Mesh(shadowrange.shade)
number_slider = Slider(0.5, range=0..1)
join = BrepJoin(Breps=boundary_2)  # -> Breps, Closed
join_2 = BrepJoin(Breps=boundary)  # -> Breps, Closed
fmerge = MergeFaces(Brep=join.Breps)  # -> Breps, Before, After
fmerge_2 = MergeFaces(Brep=join_2.Breps)  # -> Breps, Before, After
material = CreateMaterial(
    Diffuse=ColourSwatch(SwatchColor=RGB(168, 32, 32)),
    Specular=RGB(255, 255, 255),
    Emission=RGB(0, 0, 0),
    Transparency=number_slider,
    Shine=0)
material_2 = CreateMaterial(
    Diffuse=ColourSwatch(SwatchColor=RGB(98, 159, 179)),
    Specular=RGB(255, 255, 255),
    Emission=RGB(0, 0, 0),
    Transparency=number_slider,
    Shine=0)
shadow = CustomPreview(Geometry=mesh_2, Shader=material)
shade = CustomPreview(Geometry=mesh, Shader=material_2)
